# Grasshopper definition spatial_printing_tests.gh (Grasshopper 1.0.8)
# plug-ins: Robots

pt = Point(Point(606.0233562, -335.9906283, 0))
pt_2 = Point(Point(993.3243995, 37.58655568, 563.5482301))
pt_3 = Point(Point(735.5647039, -150.2565493, 0))
pt_4 = Point(Point(993.3243995, 161.4459678, 630.4516664))

# ---- group: Mixer
geo = Geometry(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)
pt_5 = Point(Point(0, 452.5, 120))

# ----
# Start point
number_slider = Slider(35, range=0..50)
Z = UnitZ(Factor=number_slider)
pt_6 = Point(pt)
move = Move(Geometry=pt_6, Motion=Z)  # -> Geometry, Transform

# ----
# Start point
number_slider_2 = Slider(35, range=0..50)
Z_2 = UnitZ(Factor=number_slider_2)
pt_7 = Point(pt_3)
move_2 = Move(Geometry=pt_7, Motion=Z_2)  # -> Geometry, Transform

pl = ConstructPlane(Origin=pt_5, XAxis="{0,0,1}", YAxis="{1,0,0}")
list = ValueList({"planar", "perpendicular", "optimized"}, selected="perpendicular")
list_2 = ValueList({"planar", "perpendicular", "optimized"}, selected="planar")

# ---- group: Sim
create_tool = CreateTool(Name="PU_Mixer", TCP=pl, Weight=Slider(2, range=0..100), Mesh=geo)  # -> Tool, TCP

# ----
# TRIG CURVE
number_slider_3 = Slider(25, range=0..100)
# angle
# different speed for different layers
py3 = Python3Script(
    start_point=move.Geometry,
    end_point=pt_2,
    num_cycles=Slider(3, range=0..10),
    curve_resolution=number_slider_3,
    amplitude=Slider(66, range=0..1000),
    wavelength=Slider(200, range=0..1000),
    base_radius=Slider(100, range=0..100),
    safe_distance=Slider(50, range=0..100),
    coef=Slider(0.02, range=0..0.1),
    mode=list)  # -> out, curve_geom, curve_planes, planes_out, robot_planes, data; inputs start_point: Point3d, end_point: Point3d, amplitude: Double, coef: Double, mode: String
# ---------- py3: Python ----------
import os, sys, importlib
import Rhino.Geometry as rg # type: ignore
import rhinoscriptsyntax as rs # type: ignore
import math 
# from compas_rhino import unload_modules


gh_dir = os.path.dirname(ghenv.Component.OnPingDocument().FilePath)
sys.path.append(gh_dir)
# print(gh_dir)

import experiments

importlib.reload(experiments)

from experiments import create_trig_curve

############--------Main Code----------#########

curve_geom, entry_planes, curve_planes, exit_planes, planes_out = create_trig_curve(
    start_point=start_point,
    end_point=end_point,
    type="sine", 
    wavelength=wavelength, 
    amplitude=amplitude, 
    num_cycles=num_cycles, 
    curve_resolution=curve_resolution,
    base_radius=base_radius,
    safe_distance=safe_distance,
    coef=coef,
    mode=mode
    )

# Translate end point 
t_vector = rg.Vector3d(start_point) 
t_vector.Reverse()
T = rg.Transform.Translation(t_vector)
end_point.Transform(T)

_, _, _, _, robot_planes = create_trig_curve(
    start_point=rg.Point3d(0,0,0),
    end_point=end_point,
    type="sine", 
    wavelength=wavelength, 
    amplitude=amplitude, 
    num_cycles=num_cycles, 
    curve_resolution=curve_resolution,
    base_radius=base_radius,
    safe_distance=safe_distance,
    coef=coef,
    mode=mode
    )

########--------Output Data---------#########
data = [len(entry_planes), len(curve_planes), len(exit_planes)]

#############-----------Print----------##########
# ---------- end py3 ----------
pln = Plane(py3.planes_out)
pln_2 = Plane(py3.robot_planes)
points = PointList(Points=py3.planes_out, Size=10)
pline = PolyLine(Vertices=pln, Closed=False)

# ----
# TRIG CURVE
number_slider_4 = Slider(20, range=0..100)
number_slider_5 = Slider(40, range=0..100)
py3_2 = Python3Script(
    start_point=move_2.Geometry,
    end_point=pt_4,
    num_cycles=Slider(2, range=0..10),
    curve_resolution=number_slider_4,
    pitch=Slider(300, range=0..1000),
    base_radius=Slider(100, range=0..100),
    safe_distance=Slider(15, range=0..100),
    mode=list_2)  # -> out, curve_geom, curve_planes, exit_planes, planes_out, robot_planes, data; inputs start_point: Point3d, end_point: Point3d, mode: String
# ---------- py3_2: Python ----------
import os, sys, importlib
import Rhino.Geometry as rg # type: ignore
import rhinoscriptsyntax as rs # type: ignore
import math 
# from compas_rhino import unload_modules


gh_dir = os.path.dirname(ghenv.Component.OnPingDocument().FilePath)
sys.path.append(gh_dir)
# print(gh_dir)

import experiments

importlib.reload(experiments)

from experiments import create_trig_spiral

############--------Main Code----------#########

curve_geom, entry_planes, curve_planes, exit_planes, planes_out = create_trig_spiral(
    start_point=start_point,
    end_point=end_point,
    pitch=pitch, 
    num_cycles=num_cycles, 
    curve_resolution=curve_resolution,
    base_radius=base_radius,
    safe_distance=safe_distance,
    mode=mode
    )

# Translate end point 
t_vector = rg.Vector3d(start_point) 
t_vector.Reverse()
T = rg.Transform.Translation(t_vector)
end_point.Transform(T)

_, _, _, _, robot_planes = create_trig_spiral(
    start_point=rg.Point3d(0,0,0),
    end_point=end_point,
    pitch=pitch, 
    num_cycles=num_cycles, 
    curve_resolution=curve_resolution,
    base_radius=base_radius,
    safe_distance=safe_distance,
    mode=mode
    )

########--------Output Data---------#########
data = [len(entry_planes), len(curve_planes), len(exit_planes)]

#############-----------Print----------##########
# ---------- end py3_2 ----------
points_2 = PointList(Points=py3_2.planes_out, Size=10)
pln_3 = Plane(py3_2.planes_out)

tag = TextTag(Location=pt, Text=list)
tag_2 = TextTag(Location=pt_3, Text=list_2)
pln_4 = Plane(py3_2.exit_planes)
pt_8 = Point(pt)

# ----
# Transform from Rhino to Robot Space
panel = Panel("35")
pln_5 = Plane(py3.robot_planes)
X = UnitX(Factor="100")
Y = UnitY(Factor="100")
fine_adjust_z_mm = Slider(1, range=-5..10)
Z_3 = UnitZ(Factor=panel)
move_3 = Move(Geometry=pt_8, Motion=X)  # -> Geometry, Transform
move_4 = Move(Geometry=pt_8, Motion=Y)  # -> Geometry, Transform
move_5 = Move(Geometry=pt_8, Motion=Z_3)  # -> Geometry, Transform
move_6 = Move(Geometry=move_3.Geometry, Motion=Z_3)  # -> Geometry, Transform
move_7 = Move(Geometry=move_4.Geometry, Motion=Z_3)  # -> Geometry, Transform
pt_9 = Point(move_5.Geometry)
pt_10 = Point(move_6.Geometry)
pt_11 = Point(move_7.Geometry)
rhino = Python3Script(way_planes=pln_5, wobj_origin=pt_9, wobj_xaxis=pt_10, wobj_xypoint=pt_11, z_safe_margin=fine_adjust_z_mm)  # -> out, transformed_planes, curves; inputs way_planes: list of Plane, wobj_origin: Point3d, wobj_xaxis: Point3d, wobj_xypoint: Point3d, z_safe_margin: Double, curves: list of Curve
# ---------- rhino: Python ----------
import Rhino.Geometry as rg
import math

def set_robot_base(origin, xaxis, xypoint):
    return rg.Plane(origin, xaxis - origin, xypoint - origin)

# def rhino_to_robot_space(rhino_plane, robot_base_plane):
#     T = rg.Transform.PlaneToPlane(rg.Plane.WorldXY, robot_base_plane)
#     robot_plane = rhino_plane.Clone()
#     robot_plane.Transform(T)
#     return robot_plane

def rhino_to_robot_space(rhino_plane, robot_base_plane, flip_z=False):
    T = rg.Transform.PlaneToPlane(rg.Plane.WorldXY, robot_base_plane)
    robot_plane = rhino_plane.Clone()

    if flip_z:
        R = rg.Transform.Rotation(math.pi, robot_plane.XAxis, robot_plane.Origin)
        robot_plane.Transform(R)

    robot_plane.Transform(T)
    return robot_plane

def set_z_safe_margin(planes, safety_margin):
    adjusted = []

    for plane in planes:
        p = plane.Clone()
        p.OriginZ += safety_margin
        adjusted.append(p)

    return adjusted

flip_z = True

robot_base = set_robot_base(wobj_origin, wobj_xaxis, wobj_xypoint)

safer_planes = set_z_safe_margin(way_planes, z_safe_margin)

transformed_planes = []
curves = curves
# for curve in curves:
#     rhino_to_robot_space(curve, robot_base, flip_z)

for plane in safer_planes:
    transformed_planes.append(rhino_to_robot_space(plane, robot_base, flip_z))
# ---------- end rhino ----------
points_3 = PointList(Points=rhino.transformed_planes, Size=10)

# ----
# Generate URscript
pln_6 = Plane(pln_3)
number_slider_6 = Slider(0.8, range=0..2)
number_slider_7 = Slider(0.01, range=0..1)
plane_tcp_to_urscript = Python3Script(
    way_planes=pln_6,
    data=py3_2.data,
    tcp_measured="{0, 0, 0}",
    radius=Slider(200, range=0..400),
    acceleration=number_slider_6,
    velocity=number_slider_7)  # -> out, script; inputs way_planes: list of Plane, data: list of Int32, tcp_measured: Point3d, radius: Double, acceleration: Double, velocity: Double
# ---------- plane_tcp_to_urscript: Python ----------
from imp import reload
import sys

sys.path.append("C:\\Users\\nadja\\Documents\\GITHUB\\F3DP\\01 tamplate\\02_RoboticDrawing\\src")


import simple_ur_script as ur
reload(ur)

import utils 
reload(utils)

import simple_comm as com
reload(com)

import Rhino.Geometry as rg
import math as m

script = "" #create empty string
entry_velocity = 0.06
exit_velocity = 0.007


# #if value given for tcp measured, then add line to script, otherwise it will take current tcp from robot
# if tcp_measured is not None:
#     script += ur.set_tcp_by_angles(tcp_measured.X, tcp_measured.Y, tcp_measured.Z, m.radians(-90.0),m.radians(-90.0),m.radians(0))

# print(len(way_planes[data[0]:data[1]]))
#calculate blend
blend_radii = utils.calculate_blend_radius(way_planes, radius=radius)
#add move_l commands to script for each way plane
# ENTRY
for plane, radius in zip(way_planes[:data[0]], blend_radii[:data[0]]):
    script += ur.move_l_blend(plane, acceleration, entry_velocity, radius)
# PRINT
for plane, radius in zip(way_planes[data[0]:data[1]+data[0]], blend_radii[data[0]:data[1]+data[0]]):
    script += ur.move_l_blend(plane, acceleration, velocity, radius)
# EXIT
for plane, radius in zip(way_planes[data[1]+data[0]:], blend_radii[data[1]+data[0]:]):
    script += ur.move_l_blend(plane, acceleration, exit_velocity, radius)


# for plane, radius in zip(way_planes, blend_radii):
#     script += ur.move_l_blend(plane, acceleration, velocity, radius)

#format the script to make it sendable
script = com.concatenate_script(script)
# ---------- end plane_tcp_to_urscript ----------
panel_2 = Panel(plane_tcp_to_urscript.script)

pt_12 = Point(pt_3)

# ----
# Transform from Rhino to Robot Space
panel_3 = Panel("35")
pln_7 = Plane(py3_2.robot_planes)
X_2 = UnitX(Factor="100")
Y_2 = UnitY(Factor="100")
fine_adjust_z_mm_2 = Slider(1, range=-5..10)
Z_4 = UnitZ(Factor=panel_3)
move_8 = Move(Geometry=pt_12, Motion=X_2)  # -> Geometry, Transform
move_9 = Move(Geometry=pt_12, Motion=Y_2)  # -> Geometry, Transform
move_10 = Move(Geometry=pt_12, Motion=Z_4)  # -> Geometry, Transform
move_11 = Move(Geometry=move_8.Geometry, Motion=Z_4)  # -> Geometry, Transform
move_12 = Move(Geometry=move_9.Geometry, Motion=Z_4)  # -> Geometry, Transform
pt_13 = Point(move_10.Geometry)
pt_14 = Point(move_12.Geometry)
pt_15 = Point(move_11.Geometry)
rhino_2 = Python3Script(way_planes=pln_7, wobj_origin=pt_13, wobj_xaxis=pt_15, wobj_xypoint=pt_14, z_safe_margin=fine_adjust_z_mm_2)  # -> out, transformed_planes, curves; inputs way_planes: list of Plane, wobj_origin: Point3d, wobj_xaxis: Point3d, wobj_xypoint: Point3d, z_safe_margin: Double, curves: list of Curve; same code as rhino
points_4 = PointList(Points=rhino_2.transformed_planes, Size=10)

# ---- group: Sim
robots_library = RobotsLibrary({"UR3e", "UR5e", "UR10e", "UR16e", "UR3", "UR5", "UR10", "UR20", "UR30"}, selected="UR10", Type=0)
load_robot_system = LoadRobotSystem(Name=robots_library, Base=PlaneXY(0, 0, 0))
number_slider_8 = Slider(0.854, range=0..1)
createtarget = CreateTarget(Plane=rhino_2.transformed_planes, Tool=create_tool.Tool, Speed=Slider(300, range=0..1000), IsCartesian=True)
create_program = CreateProgram(Name="DefaultProgram", RobotSystem=load_robot_system, Targets=createtarget, StepSize=1)  # -> Program, Code, Duration, Warnings, Errors
program_simulation = ProgramSimulation(Program=create_program.Program, Time=0, Normalized=True)  # -> SystemMeshes, JointRotations, Plane, Index, Time, Program, Errors
panel_4 = Panel(create_program.Warnings)
panel_5 = Panel(program_simulation.JointRotations)

# ----
preview = CustomPreview(
    Geometry=program_simulation.SystemMeshes,
    Material={diffuse=RGB(221, 160, 221), emission=RGB(66, 48, 66), shine=0.5, specular=RGB(255, 255, 255), transparency=0})
pln_8 = Plane(program_simulation.Plane)
pline_2 = PolyLine(Vertices=rhino.transformed_planes, Closed=False)
pln_9 = Plane(rhino.transformed_planes)
pline_3 = PolyLine(Vertices=rhino_2.transformed_planes, Closed=False)
pln_10 = Plane(rhino_2.transformed_planes)
pipe = Pipe(Curve=pline_2, Radius="23", Caps=0, FitRail=False)
cap = CapHoles(Brep=pipe)
pipe_2 = Pipe(Curve=pline_3, Radius="23", Caps=0, FitRail=False)
preview_2 = CustomPreview(Geometry=cap, Material=ColourSwatch(SwatchColor=RGB(163, 163, 127)))
button = Button()

# ---- group: Save UR script to Robot!
py3_3 = Python3Script(script=plane_tcp_to_urscript.script, mode=list_2, save=Toggle(False))  # -> out, a, msg; inputs script: String, mode: String, save: Boolean
# ---------- py3_3: Python ----------
import os
from datetime import datetime

msg = "Waiting for save trigger..."
folder_path = "C:\\Users\\nadja\\Documents\\GITHUB\\F3DP\\04 data"

if save:
    # 1. Ensure the folder exists
    if not os.path.exists(folder_path):
        try:
            os.makedirs(folder_path)
        except Exception as e:
            msg = f"Error creating folder: {e}"
            
    # 2. Generate file name with today's date and versioning
    if os.path.exists(folder_path):
        date_today = datetime.now().strftime("%Y-%m-%d")
        
        # Search for an available version number (n) so we don't overwrite previous runs
        version = 1
        while True:
            file_name = f"ETH_{date_today}_{mode}_v{version}.urp"
            full_path = os.path.join(folder_path, file_name)
            if not os.path.exists(full_path):
                break
            version += 1

        # 3. Write the script
        try:
            with open(full_path, "w", encoding="utf-8") as file:
                file.write(script)
            msg = f"Successfully exported: {file_name}"
        except Exception as e:
            msg = f"Failed to write file: {e}"
else:
    msg = "Set 'save' trigger to True to export."

# Component output status
a = msg
# ---------- end py3_3 ----------

# ----
cap_2 = CapHoles(Brep=pipe_2)
preview_3 = CustomPreview(Geometry=cap_2, Material=ColourSwatch(SwatchColor=RGB(163, 163, 127)))
panel_6 = Panel(py3_3.msg)
