# Grasshopper definition 301_robot_visualization_T3_2.ghx (Grasshopper 1.0.8)
# plug-ins: Robots, Human

# ---- group: Mixer
geo = Geometry(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)
pln = Plane(PlaneXY(-404.2, 0, 1031.98))

xy = XYPlane(Origin=Point(0, 0, 0))
geo_2 = Geometry(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)
pt = Point(Point(0, 452.5, 120))

# ----
pl = ConstructPlane(Origin=pt, XAxis="{0,0,1}", YAxis="{1,0,0}")

# ---- group: Mixer
xy_2 = XYPlane(Origin=Point(0, 0, 0))
geo_3 = Geometry(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)
pt_2 = Point(Point(-1.97444779e-10, -452.5045299, 120))

# ----
pl_2 = ConstructPlane(Origin=pt_2, XAxis="{-1,0,0}", YAxis="{0,0,-1}")
swatch = ColourSwatch(SwatchColor=RGB(255, 255, 255))

# ----
# Generate Planes
crv = Curve(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)
srf = Surface(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)
curve_to_planes__non_planar = Python3Script(C=crv, S=srf, point_spacing=Slider(150, range=0..600))  # -> out, my_way_planes; inputs C: Curve, S: Surface, point_spacing: Double
# ---------- curve_to_planes__non_planar: Python ----------
import Rhino.Geometry as rg
import math


def as_list(x):
    if x is None:
        return []
    return x if isinstance(x, (list, tuple)) else [x]


def divide_crv(crv, spacing):
    length = crv.GetLength()
    if length <= 0 or spacing <= 0:
        return []

    pts = []
    count = int(math.ceil(length / spacing))

    for i in range(count + 1):
        d = min(i * spacing, length)
        ok, t = crv.LengthParameter(d)
        if ok:
            pts.append(crv.PointAt(t))

    return pts


def safe_unit(v, fallback): # unitize vector
    v = rg.Vector3d(v)

    if v.Length < 0.001:
        v = rg.Vector3d(fallback)

    v.Unitize()
    return v


def get_xaxis(pts, i):
    if len(pts) < 2:
        return rg.Vector3d(1, 0, 0)

    if i == 0:
        xaxis = pts[1] - pts[0]
    else:
        xaxis = pts[i] - pts[i - 1]

    return safe_unit(xaxis, rg.Vector3d(1, 0, 0))


def make_planar_planes(pts, curve, flip=False):
    planes = []

    for i, pt in enumerate(pts):
        plane = rg.Plane.CreateFromNormal(pt,rg.Vector3d(0,0,1))
        planes.append(plane)

    return planes

def make_nonplanar_planes(pts, curve, surface, flip=False):
    planes = []

    for pt in pts:
        ok, t = curve.ClosestPoint(pt)
        xaxis = curve.TangentAt(t) if ok else rg.Vector3d(1, 0, 0)
        xaxis = safe_unit(xaxis, rg.Vector3d(1, 0, 0))

        ok, u, v = surface.ClosestPoint(pt)
        yaxis = surface.NormalAt(u, v) if ok else rg.Vector3d(0, 0, 1)
        yaxis = safe_unit(yaxis, rg.Vector3d(0, 0, 1))
        
        if flip:
            yaxis *= -1

        zaxis = rg.Vector3d.CrossProduct(xaxis, yaxis)
        zaxis = safe_unit(zaxis, rg.Vector3d(0, 1, 0))

        yaxis = rg.Vector3d.CrossProduct(zaxis, xaxis)
        yaxis = safe_unit(yaxis, rg.Vector3d(0, 0, 1))

        planes.append(rg.Plane(pt, xaxis, yaxis))

    return planes


nonplanar = False
my_way_planes = []

for crv in as_list(C):
    pts = divide_crv(crv, point_spacing)

    if nonplanar and S:
        my_way_planes.extend(make_nonplanar_planes(pts, C, S, flip=False)) # C: single curve
    else:
        my_way_planes.extend(make_planar_planes(pts, C, flip=False))
# ---------- end curve_to_planes__non_planar ----------
pln_2 = Plane(curve_to_planes__non_planar.my_way_planes)

pt_3 = Point(Point(-26.45001516, -579.6806621, 0))
X = UnitX(Factor="-100")
Y = UnitY(Factor="100")
move = Move(Geometry=pt_3, Motion=X)  # -> Geometry, Transform
move_2 = Move(Geometry=pt_3, Motion=Y)  # -> Geometry, Transform

# ----
# Transform from Rhino to Robot Space
pln_3 = Plane(pln_2)
fine_adjust_z_mm = Slider(0.8, range=-5..10)
pt_4 = ConstructPoint(XCoordinate="535.90", YCoordinate="101.40", ZCoordinate="-9.39")
pt_5 = ConstructPoint(XCoordinate="246.86", YCoordinate="-314.78", ZCoordinate="-10.85")
pt_6 = ConstructPoint(XCoordinate="534.35", YCoordinate="-315.60", ZCoordinate="-9.96")
rhino = Python3Script(
    way_planes=pln_3,
    wobj_origin=pt_3,
    wobj_xaxis=move_2.Geometry,
    wobj_xypoint=move.Geometry,
    z_safe_margin=fine_adjust_z_mm)  # -> out, transformed_planes; inputs way_planes: list of Plane, wobj_origin: Point3d, wobj_xaxis: Point3d, wobj_xypoint: Point3d, z_safe_margin: Double
# ---------- rhino: Python ----------
import Rhino.Geometry as rg
import math

def set_robot_base(origin, xaxis, xypoint):
    return rg.Plane(origin, xaxis - origin, xypoint - origin)

# def rhino_to_robot_space(rhino_plane, robot_base_plane):
#     T = rg.Transform.PlaneToPlane(rg.Plane.WorldXY, robot_base_plane)
#     robot_plane = rhino_plane.Clone()
#     robot_plane.Transform(T)
#     return robot_plane

def rhino_to_robot_space(rhino_plane, robot_base_plane, flip_z=False):
    T = rg.Transform.PlaneToPlane(rg.Plane.WorldXY, robot_base_plane)
    robot_plane = rhino_plane.Clone()

    if flip_z:
        R = rg.Transform.Rotation(math.pi, robot_plane.XAxis, robot_plane.Origin)
        robot_plane.Transform(R)

    robot_plane.Transform(T)
    return robot_plane

def set_z_safe_margin(planes, safety_margin):
    adjusted = []

    for plane in planes:
        p = plane.Clone()
        p.OriginZ += safety_margin
        adjusted.append(p)

    return adjusted

flip_z = True

robot_base = set_robot_base(wobj_origin, wobj_xaxis, wobj_xypoint)

safer_planes = set_z_safe_margin(way_planes, z_safe_margin)

transformed_planes = []

for plane in safer_planes:
    transformed_planes.append(rhino_to_robot_space(plane, robot_base, flip_z))
# ---------- end rhino ----------
points = PointList(Points=rhino.transformed_planes, Size=10)

plane = Plane(rhino.transformed_planes)
polyline = PolyLine(Vertices=rhino.transformed_planes, Closed=False)

# ---- group: Preview
colour_swatch = ColourSwatch(SwatchColor=RGB(0, 254, 0))
polyline_2 = PolyLine(Vertices=plane, Closed=False)
cylinder = Cylinder(Base=PlaneXY(0, 0, 0), Radius=Slider(25, range=0..100), Length=Slider(40, range=0..100))
rectangle_3pt = Rectangle3Pt(PointA=pt_6, PointB=pt_4, PointC=pt_5)  # -> graft(Rectangle), Length
custom_preview_lineweights = CustomPreviewLineweights(Geometry=polyline, Shader=colour_swatch, Thickness=Slider(5, range=0..10), Absolute=False)
plane_2 = Plane(plane)
deconstruct_plane = DeconstructPlane(Plane=plane_2)  # -> Origin, XAxis, YAxis, ZAxis
vector_display = VectorDisplay(Anchor=deconstruct_plane.Origin, Vector=deconstruct_plane.XAxis)
point_list = PointList(Points=plane, Size=Slider(3, range=0..10))
custom_preview = CustomPreview(
    Geometry=[cylinder, rectangle_3pt.Rectangle],
    Material=[colour_swatch, ColourSwatch(SwatchColor=RGB(255, 0, 0)), ColourSwatch(SwatchColor=RGB(0, 0, 255)), ColourSwatch(SwatchColor=RGB(0, 254, 255))])

# ---- group: Sim
create_tool = CreateTool(Name="PU_Mixer", TCP=pl, Weight=Slider(10, range=0..100), Mesh=geo_2)  # -> Tool, TCP

# ----
pln_4 = Plane(rhino.transformed_planes)

# ----
# Convert Planes to URScript
number_slider = Slider(1, range=0..2)
number_slider_2 = Slider(0.2, range=0..1)
pt_7 = ConstructPoint(XCoordinate="-120", YCoordinate="0", ZCoordinate="-452.5")
rhino_2 = Python3Script(
    way_planes=rhino.transformed_planes,
    tcp_measured=pt,
    radius=Slider(6, range=0..20),
    acceleration=number_slider,
    velocity=number_slider_2)  # -> out, script; inputs way_planes: list of Plane, tcp_measured: Point3d, radius: Double, acceleration: Double, velocity: Double
# ---------- rhino_2: Python ----------
from imp import reload
import sys

sys.path.append("C:\\Users\\nadja\\Documents\\GITHUB\\F3DP\\01 tamplate\\02_RoboticDrawing\\src")

import simple_ur_script as ur
reload(ur)

import utils 
reload(utils)

import simple_comm as com
reload(com)

import Rhino.Geometry as rg
import math as m

script = "" #create empty string

#if value given for tcp measured, then add line to script, otherwise it will take current tcp from robot
if tcp_measured is not None:
    script += ur.set_tcp_by_angles(tcp_measured.X, tcp_measured.Y, tcp_measured.Z, m.radians(0.0),m.radians(0.0),m.radians(0))

#calculate blend
blend_radii = utils.calculate_blend_radius(way_planes, radius=radius)
#add move_l commands to script for each way plane
for plane, radius in zip(way_planes, blend_radii):
    script += ur.move_l_blend(plane, acceleration, velocity, radius)


#format the script to make it sendable
script = com.concatenate_script(script)
# ---------- end rhino_2 ----------

# ---- group: Sim
robots_library = RobotsLibrary({"UR3e", "UR5e", "UR10e", "UR16e", "UR3", "UR5", "UR10", "UR20", "UR30"}, selected="UR10", Type=0)
load_robot_system = LoadRobotSystem(Name=robots_library, Base=PlaneXY(0, 0, 0))
number_slider_3 = Slider(0.865, range=0..1)
createtarget = CreateTarget(Plane=pln_4, Tool=create_tool.Tool, Speed=number_slider_2, IsCartesian=True)
create_program = CreateProgram(Name="DefaultProgram", RobotSystem=load_robot_system, Targets=createtarget, StepSize=1)  # -> Program, Code, Duration, Warnings, Errors
program_simulation = ProgramSimulation(Program=create_program.Program, Time=0, Normalized=True)  # -> SystemMeshes, JointRotations, Plane, Index, Time, Program, Errors
panel = Panel(create_program.Warnings)
panel_2 = Panel(program_simulation.Errors)

# ----
pline = PolyLine(Vertices=pln_4, Closed=False)
programsimulation = ProgramSimulation(Program=create_program.Program, Time=Slider(0.871, range=0..1), Normalized=True)  # -> SystemMeshes, JointRotations, Plane, Index, Time, Program, Errors

# ---- group: Send UR script to Robot!
# Send to Robot!
button = Button()
py3 = Python3Script(script=rhino_2.script, ip_address="192.168.10.10", send=button)  # -> out, a; inputs script: String, ip_address: String, send: Boolean
# ---------- py3: Python ----------
import simple_comm as com

if send:
    com.send_script(script,ip_address)
# ---------- end py3 ----------

# ----
urscript = Panel(rhino_2.script)
preview = CustomPreview(
    Geometry=programsimulation.SystemMeshes,
    Material={diffuse=RGB(221, 160, 221), emission=RGB(66, 48, 66), shine=0.5, specular=RGB(255, 255, 255), transparency=0})
