# Grasshopper definition DEVELOPing_Bridging span_for chechking.gh (Grasshopper 1.0.8)
# plug-ins: treesloth01, Pufferfish

# ---- group: Lift Bridging for compensation
wall_height = Slider(245, range=0..300)
wall_height_2 = Slider(90, range=0..100)

X = UnitX(Factor=1)
Z = UnitZ(Factor=wall_height)
Z_2 = UnitZ(Factor=wall_height_2)
layer_height = Slider(12, range=0..30)
pt = ConstructPoint(XCoordinate=0, YCoordinate=0, ZCoordinate=layer_height)
line = LineSDL(Start=pt, Direction=X, Length=Slider(395, range=0..1000))
rotate = Rotate(Geometry=line, Angle=degrees(Slider(90, range=0..180)), Plane=PlaneXY(0, 0, 0))  # -> Geometry, Transform
extr = Extrude(Base=rotate.Geometry, Direction=Z_2)
extr_2 = Extrude(Base=line, Direction=Z)
join = BrepJoin(Breps=[extr_2, extr])  # -> Breps, Closed
contour = Contour(Shape=join.Breps, Point=pt, Direction=Vector(0, 0, 1), Distance=layer_height)  # -> flatten(Contours)
py3 = Python3Script(C=contour)  # -> out, curves, long_crvs, upper_crv, lower_crv; inputs C: list of Curve
# ---------- py3: Python ----------
def get_length(crv):
    return crv.GetLength() if hasattr(crv, "GetLength") else crv.Length


def get_left_segment(crv):
    segments = list(crv.DuplicateSegments())
    return min(
        segments,
        key=lambda seg: seg.PointAtNormalizedLength(0.5).X
    )


input_curves = list(C)
lengths = [get_length(crv) for crv in input_curves]

short_crvs = []
long_crvs = []

if input_curves:
    limit = sum(lengths) / len(lengths)

    for crv, length in zip(input_curves, lengths):
        if length < limit:
            short_crvs.append(crv)
        else:
            long_crvs.append(crv)

    difference = abs(len(long_crvs) - len(short_crvs))

    if difference % 2 == 0 and short_crvs:
        short_crvs.pop()

curves = long_crvs + short_crvs

upper_crv = short_crvs[-1] if short_crvs else None
lower_crv = get_left_segment(long_crvs[-1]) if long_crvs else None
# lower_crv = long_crvs[-1].DuplicateSegments()[0]
# ---------- end py3 ----------

# ---- group: Lift Bridging for compensation / Insert pts in crvs
reparamcrv = ReparameterizeCurve(Curve=py3.long_crvs)  # -> Reparameterized, Original
explode = Explode(Curve=reparamcrv.Reparameterized, Recursive=True)  # -> Segments, Vertices
pt_position = Slider(0.03, range=0..1)
item = ListItem(List=explode.Vertices, Index=0, Wrap=True)  # -> Item, Item1
crv_cp = CurveClosestPoint(Point=flatten(item.Item1), Curve=reparamcrv.Reparameterized)  # -> Point, Parameter, Distance
expression = Expression(x=crv_cp.Parameter, y=pt_position, Expression="x-y")  # -> graft(R)
expression_2 = Expression(x=crv_cp.Parameter, y=pt_position, Expression="x+y")  # -> graft(R)
shatter = Shatter(Curve=graft(reparamcrv.Reparameterized), Parameters=[expression, expression_2])
join_2 = JoinCurves(Curves=flatten(shatter), Preserve=False)
replace = ReplaceItems(List=py3.curves, Item=join_2, Indices="0", Wrap=False)

# ---- group: Lift Bridging for compensation
# bridging start from taller wall
number_slider = Slider(10, range=0..100)
neg = Negative(Value=number_slider)
vec = VectorXYZ(XComponent=0, YComponent=neg, ZComponent=layer_height)  # -> Vector, Length
move = Move(Geometry=py3.upper_crv, Motion=vec.Vector)  # -> Geometry, Transform
flip = FlipCurve(Curve=move.Geometry)  # -> Curve, Flag

# bridging start from shorter wall
number_slider_2 = Slider(10, range=0..100)
neg_2 = Negative(Value=number_slider_2)
vec_2 = VectorXYZ(XComponent=neg_2, YComponent=0, ZComponent=layer_height)  # -> Vector, Length
move_2 = Move(Geometry=py3.lower_crv, Motion=vec_2.Vector)  # -> Geometry, Transform
flip_2 = FlipCurve(Curve=move_2.Geometry)  # -> Curve, Flag

stack = StackTrees(Data0=flip.Curve, Data1=flip_2.Curve, Reduce=True)

len = Length(Curve=replace)
sort = SortList(Keys=len, ValuesA=replace)  # -> Keys, ValuesA
item_2 = ListItem(List=sort.Keys, Index=0, Wrap=True)
smaller = SmallerThan(FirstNumber=replace, SecondNumber=expr("x+1", item_2))  # -> SmallerThan, OrEqualTo
dispatch = Dispatch(List=replace, DispatchPattern=smaller.OrEqualTo)  # -> ListA, ListB
crv = Curve(dispatch.ListA)
flip_3 = FlipCurve(Curve=crv)  # -> Curve, Flag
weave = Weave(Pattern=smaller.OrEqualTo, Stream0=dispatch.ListB, Stream1=flip_3.Curve, NullGaps=False)

dispatch_2 = Dispatch(List=weave, DispatchPattern=[True, False])  # -> ListA, ListB
flip_4 = FlipCurve(Curve=dispatch_2.ListA)  # -> Curve, Flag
weave_2 = Weave(Pattern=[0, 1], Stream0=flip_4.Curve, Stream1=dispatch_2.ListB, NullGaps=False)
end = EndPoints(Curve=weave_2)  # -> Start, End
cull_i = CullIndex(List=end.Start, Indices="0", Wrap=True)
cull_i_2 = CullIndex(List=end.End, Indices="-1", Wrap=True)
ln = Line(StartPoint=cull_i_2, EndPoint=cull_i)
merge = Merge(Data1=weave_2, Data2=ln)  # -> flatten(Result)
join_walls = JoinCurves(Curves=merge, Preserve=False)

neg_3 = Negative(Value=Slider(80, range=0..100))
panel = Panel("0")
ext_upper_crv = ExtendCurve(Curve=flip.Curve, Type=0, Start=neg_3, End=panel)
bridge_spacing = Slider(52, range=0..100)
vec_3 = VectorXYZ(XComponent=Slider(30, range=0..100), YComponent=Slider(30, range=0..100), ZComponent=Slider(20, range=0..100))  # -> Vector, Length

ext_wall_crv = ExtendCurve(Curve=join_walls, Type=0, Start=panel, End=neg_3)
end_2 = EndPoints(Curve=ext_wall_crv)  # -> simplify(Start), End
pt_2 = Point(end_2.End)

ext_lower_crv = ExtendCurve(Curve=move_2.Geometry, Type=0, Start=panel, End=neg_3)
neg_4 = Negative(Value=Slider(150, range=0..200))
vec_4 = VectorXYZ(XComponent=neg_4, YComponent=Slider(60, range=0..100), ZComponent=Slider(50, range=0..100))  # -> Vector, Length
move_3 = Move(Geometry=pt_2, Motion=vec_4.Vector)  # -> Geometry, Transform

lower_pts = DivideLength(Curve=ext_lower_crv, Length=bridge_spacing)  # -> reverse(Points), Tangents, Parameters
upper_pts = DivideLength(Curve=ext_upper_crv, Length=bridge_spacing)  # -> Points, Tangents, Parameters
move_4 = Move(Geometry=upper_pts.Points, Motion=vec_3.Vector)  # -> Geometry, Transform

item_3 = ListItem(List=lower_pts.Points, Index=0, Wrap=True)

# ---- group: Lift Bridging for compensation / Lifting Bridging
ln_2 = Line(StartPoint=lower_pts.Points, EndPoint=upper_pts.Points)
midpt = CurveMiddle(Curve=ln_2)
pl = ConstructPlane(Origin=midpt, XAxis=ln_2, YAxis=Vector(0, 1, 0))
item_4 = ListItem(List=pl, Index=0, Wrap=True)  # -> Item1, Item
align = AlignPlanes(Planes=pl, Master=item_4.Item1)
deplane = DeconstructPlane(Plane=align)  # -> Origin, XAxis, YAxis, ZAxis
amp = Amplitude(Vector=deplane.ZAxis, Amplitude=Slider(30, range=0..100))
lift_pts = Move(Geometry=midpt, Motion=amp)  # -> Geometry, Transform
panel_2 = Panel("""0
1
2
3""")
stack_2 = StackTrees(Data0=lower_pts.Points, Data1=lift_pts.Geometry, Data2=upper_pts.Points, Reduce=True)
weave_3 = Weave(
    Pattern=panel_2,
    Stream0=lower_pts.Points,
    Stream1=lift_pts.Geometry,
    Stream2=upper_pts.Points,
    Stream3=move_4.Geometry,
    NullGaps=False)
flip_5 = FlipMatrix(Data=stack_2)
intcrv = Interpolate(Vertices=flip_5, Degree=3, Periodic=False, KnotStyle=1)  # -> Curve, Length, Domain

# ---- group: Lift Bridging for compensation / Straight Bridging
panel_3 = Panel("""0
1
2""")
weave_4 = Weave(Pattern=panel_3, Stream0=lower_pts.Points, Stream1=upper_pts.Points, Stream2=move_4.Geometry, NullGaps=False)
points = PointList(Points=weave_4, Size=15)

# ---- group: Lift Bridging for compensation / Straight Bridging / Bridges
pline = PolyLine(Vertices=weave_4, Closed=False)

# ---- group: Lift Bridging for compensation / Lifting Bridging / Bridges
# TCP
pline_2 = PolyLine(Vertices=weave_3, Closed=False)

# ---- group: Lift Bridging for compensation
lng = ListLength(List=py3.long_crvs)
lng_2 = ListLength(List=lower_pts.Points)
py3_2 = Python3Script(
    slow_start=Slider(68, range=0..100),
    pair=lng_2,
    pair_num=Slider(2, range=0..10),
    lower_start=Slider(3, range=0..10),
    step=Slider(5, range=0..10),
    layer_amount=lng)  # -> out, slow_id, fast_id; inputs slow_start: Int32, pair: Int32, pair_num: Int32, lower_start: Int32, step: Int32, layer_amount: Int32
# ---------- py3_2: Python ----------
slow_start += 1
lower_start += 1
group_step = pair_num + 2

slow_id = [
    slow_start + i * group_step + j
    for i in range(pair)
    for j in range(pair_num)
]

part_a = [
    lower_start + i * step
    for i in range(layer_amount)
]

part_b = [
    value
    for i in range(slow_start - 2, slow_start + group_step * pair, group_step)
    for value in (i, i + 1)
]

fast_id = part_a + part_b + ([part_b[-1] + 1] if part_b else [])
# ---------- end py3_2 ----------
slow = Panel(py3_2.slow_id)
fast = Panel(py3_2.fast_id)

stack_3 = StackTrees(Data0=pt_2, Data1=move_3.Geometry, Data2=item_3, Reduce=True)  # -> flatten(Tree)
pline_3 = PolyLine(Vertices=stack_3, Closed=False)

# ---- group: Lift Bridging for compensation / Wall + Transition
join_3 = JoinCurves(Curves=flatten([pline_3, ext_wall_crv]), Preserve=False)

# ---- group: Lift Bridging for compensation (continued)
merge_2 = Merge(Data1=pline_2, Data2=join_3)
join_4 = JoinCurves(Curves=flatten(merge_2), Preserve=False)

# ---- group: Lift Bridging for compensation / Exit path
enter_length = Slider(100, range=0..100)
exit_length = Slider(100, range=0..300)
ext = ExtendCurve(Curve=join_4, Type=0, Start=enter_length, End=exit_length)
end_3 = EndPoints(Curve=ext)  # -> Start, End
vec_5 = VectorXYZ(XComponent=Slider(50, range=0..1000), YComponent=0, ZComponent=0)  # -> Vector, Length
line_2 = LineSDL(Start=end_3.End, Direction=vec_5.Vector, Length=vec_5.Vector)
join_5 = JoinCurves(Curves=flatten([ext, line_2]), Preserve=False)
crv_bridging = Curve(join_5)

# ---- group: Lift Bridging for compensation
# To Printing Bed
number_slider_3 = Slider(400, range=0..1000)
vec_6 = VectorXYZ(XComponent=number_slider_3, YComponent=Slider(-100, range=-1000..500), ZComponent="32")  # -> Vector, Length
move_5 = Move(Geometry=crv_bridging, Motion=vec_6.Vector)  # -> Geometry, Transform
explode_2 = Explode(Curve=move_5.Geometry, Recursive=True)  # -> Segments, Vertices

# Generate URscript
# Different velocities depend on vector
# Add a transition plane
pln = Plane(explode_2.Vertices)
panel_4 = Panel("{0, 0, 0}")
v_h_m_s = Slider(0.035, range=0..1)
v_d_m_s = Slider(0.22, range=0..1)
v_u_m_s = Slider(0.007, range=0..1)
a_m_s = Slider(0.1, range=0..1)
plane_tcp_to_urscript = Python3Script(
    planes=pln,
    radius=Slider(12, range=0..200),
    acceleration=a_m_s,
    velocity_normal=v_h_m_s,
    velocity_fast=v_d_m_s,
    velocity_slow=v_u_m_s,
    slow_id=py3_2.slow_id,
    fast_id=py3_2.fast_id)  # -> out, script; inputs planes: list of Plane, tcp_measured: Point3d, radius: Double, acceleration: Double, velocity_normal: Double, velocity_fast: Double, velocity_slow: Double, velocity_a: Double, slow_id: list of Int32, fast_id: list of Int32, velocity_a_id: list of Int32
# ---------- plane_tcp_to_urscript: Python ----------
from imp import reload
import sys
import math as m
import Rhino.Geometry as rg

sys.path.append(r"C:\Users\user\github\F3DP\01 tamplate\02_RoboticDrawing\src")

import simple_ur_script as ur
import utils
import simple_comm as com

reload(ur)
reload(utils)
reload(com)


def as_list(x):
    if x is None:
        return []
    return list(x) if hasattr(x, "__iter__") else [x]


def get_speed(i):
    if i in as_list(velocity_a_id):
        return velocity_a
    if i in as_list(fast_id):
        return velocity_fast
    if i in as_list(slow_id):
        return velocity_slow
    return velocity_normal


def interpolate_plane(a, b, origin, t):
    axis = rg.Vector3d.CrossProduct(a.ZAxis, b.ZAxis)
    angle = rg.Vector3d.VectorAngle(a.ZAxis, b.ZAxis)
    x, y = rg.Vector3d(a.XAxis), rg.Vector3d(a.YAxis)

    if axis.Unitize():
        rot = rg.Transform.Rotation(angle * t, axis, rg.Point3d.Origin)
        x.Transform(rot)
        y.Transform(rot)

    return rg.Plane(origin, x, y)


transition_ratio = 0.3
angle_tolerance = m.radians(1)
script = ""

if tcp_measured is not None:
    script += ur.set_tcp_by_angles(
        tcp_measured.X, tcp_measured.Y, tcp_measured.Z,
        m.radians(-90), m.radians(-90), 0
    )

blend_radii = utils.calculate_blend_radius(planes, radius)

for i, plane in enumerate(planes):
    speed = get_speed(i)

    if i == 0 or i == len(planes) - 1:
        script += ur.move_l_blend(
            plane, acceleration, speed, blend_radii[i]
        )
        continue

    prev = planes[i - 1]
    angle = rg.Vector3d.VectorAngle(prev.ZAxis, plane.ZAxis)

    if angle > angle_tolerance:
        next_plane = planes[i + 1]
        transition = rg.Plane(plane.Origin, prev.XAxis, prev.YAxis)

        script += ur.move_l_blend(
            transition, acceleration, speed, 0
        )

        origin = plane.Origin + (
            next_plane.Origin - plane.Origin
        ) * transition_ratio

        smooth_plane = interpolate_plane(
            transition, plane, origin, 1.0
        )

        dist = transition.Origin.DistanceTo(smooth_plane.Origin)
        blend = min(abs(radius), dist * 0.4)

        script += ur.move_l_blend(
            smooth_plane, acceleration, speed, blend
        )

    else:
        script += ur.move_l_blend(
            plane, acceleration, speed, blend_radii[i]
        )

script = com.concatenate_script(script)
# ---------- end plane_tcp_to_urscript ----------
panel_5 = Panel(plane_tcp_to_urscript.script)

# ---- group: Lift Bridging for compensation / Send UR script to Robot!
py3_3 = Python3Script(script=plane_tcp_to_urscript.script, ip_address="192.168.10.10", send=Button())  # -> out, a; inputs script: String, ip_address: String, send: Boolean
# ---------- py3_3: Python ----------
import simple_comm as com

if send:
    com.send_script(script,ip_address)
# ---------- end py3_3 ----------
